# Dynamo graph Test.dyn (Dynamo 2.10.1.3976)

select_model_elements_by = DSModelElementsByCategorySelection(index=686)  # "Select Model Elements By Category"; 2 picked in the model
watch = Watch(select_model_elements_by)
pick_evaluate_adjust = Custom[Pick_evaluate_adjust](dict=watch)  # Pick wall elelements, evaluate optimization opportunity, adjust layers and thicknesses
watch_2 = Watch(pick_evaluate_adjust.Elements_name)
alert_Popout = Custom[Alert_Popout](Error=pick_evaluate_adjust.Error, Error_Text=pick_evaluate_adjust.Error_Text)  # Show alerts from the code
watch_3 = Watch(pick_evaluate_adjust.Elements)
update_thicknesses = Custom[Update_thicknesses](dict=watch_3)  # Updating thicknesses of selected elements
